# Grasshopper definition optimization.gh (Grasshopper 1.0.7)
# plug-ins: MetaOptims, MetaComponent

x9 = Slider(0, range=-100..100)
x4 = Slider(0, range=-100..100)
x10 = Slider(0, range=-100..100)
x7 = Slider(0, range=-100..100)
x5 = Slider(0, range=-100..100)
x8 = Slider(0, range=-100..100)
x2 = Slider(0, range=-100..100)
x3 = Slider(0, range=-100..100)
x6 = Slider(0, range=-100..100)
x1 = Slider(0, range=-100..100)
x9_2 = Slider(0, range=-100..100)
x4_2 = Slider(0, range=-100..100)
x10_2 = Slider(0, range=-100..100)
x7_2 = Slider(0, range=-100..100)
x5_2 = Slider(0, range=-100..100)
x8_2 = Slider(0, range=-100..100)
x2_2 = Slider(0, range=-100..100)
x3_2 = Slider(0, range=-100..100)
x6_2 = Slider(0, range=-100..100)
x1_2 = Slider(0, range=-100..100)
x9_3 = Slider(0, range=-100..100)
x4_3 = Slider(0, range=-100..100)
x10_3 = Slider(0, range=-100..100)
x7_3 = Slider(0, range=-100..100)
x5_3 = Slider(0, range=-100..100)
x8_3 = Slider(0, range=-100..100)
x2_3 = Slider(0, range=-100..100)
x3_3 = Slider(0, range=-100..100)
x6_3 = Slider(0, range=-100..100)
x1_3 = Slider(0, range=-100..100)
sqr = Square(Value=[x2, x1, x3, x4, x5, x6, x7, x8, x9, x10, x1_3, x2_3, x3_3, x4_3, x5_3, x6_3, x7_3, x8_3, x9_3, x10_3, x1_2, x2_2, x3_2, x4_2, x5_2, x6_2, x7_2, x8_2, x9_2, x10_2])
ma = MassAddition(Input=sqr)  # -> Result, PartialResults
optimizer = MetaOptim(
    Variables=[x4_2, x1, x2, x3, x4, x5, x6, x7, x8, x9, x10, x1_3, x2_3, x3_3, x4_3, x5_3, x6_3, x7_3, x8_3, x9_3, x10_3, x1_2, x2_2, x3_2, x5_2, x6_2, x7_2, x8_2, x9_2, x10_2],
    Objective=ma.Result)
panel = Panel(sqr)
metaalgo = MetaComponent(
    Variables=[x1, x2, x3, x4, x5, x6, x7, x8, x9, x10, x1_3, x2_3, x3_3, x4_3, x5_3, x6_3, x7_3, x8_3, x9_3, x10_3, x1_2, x2_2, x3_2, x4_2, x5_2, x6_2, x7_2, x8_2, x9_2, x10_2],
    Objectives=ma.Result)
panel_2 = Panel(ma.Result)
